# Grasshopper definition knot_vector.gh (Grasshopper 1.0.7)

crv = Curve(reparameterize(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))
crv_2 = Curve(reparameterize(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))
python = GhPythonScript(x=crv_2)  # -> out, a
# ---------- python: Python ----------
import rhinoscriptsyntax as rs

def ListKnotVector():
    curve = x
    if curve is None:
        return
    
    knot = rs.CurveKnots(curve)
    if knot is None:
        print("NULL knot vector")
        return
    
    # order = degree + 1
    order = rs.CurveDegree(curve) + 1
    if order < 2:
        print("knot vector order < 2")
        return
    
    cv_count = rs.CurvePointCount(curve)
    if cv_count < order:
        print("knot vector cv_count < order")
        return
    
    if order >= 2 and cv_count >= order and knot:
        knot_count = order + cv_count - 2
        i = 0
        i0 = 0
        print("index, value, mult, delta")
        while i < knot_count:
            mult = 1
            while i + mult < knot_count:
                if knot[i] == knot[i + mult]:
                    mult += 1
                else:
                    break
            
            if i == 0:
                print(str(i) + ", " + str(knot[i]) + ", " + str(mult))
            else:
                print(str(i) + ", " + str(knot[i]) + ", " + str(mult) + ", " + str(knot[i] - knot[i0]))
            
            i0 = i
            i += mult

ListKnotVector()
# ---------- end python ----------
panel = Panel(python.out)
