# Grasshopper definition mesh_to_array_representation.gh (Grasshopper 1.0.7)

mesh = Mesh(<mesh referenced from the Rhino model>)
python = GhPythonScript(x=mesh)  # -> out, a; inputs x: Mesh
# ---------- python: Python ----------
import Rhino.Geometry as rg
import json

output = []

for face in x.Faces:
    a = x.Vertices[face.A]
    b = x.Vertices[face.B]
    c = x.Vertices[face.C]
    #print([a.X, a.Y, a.Z, b.X, b.Y, b.Z, c.X, c.Y, c.Z])
    output.append(map(lambda x: format(float(x), '.3f'), [a.X, a.Y, a.Z, b.X, b.Y, b.Z, c.X, c.Y, c.Z]))
    

a = json.dumps(output)
# ---------- end python ----------
panel = Panel(python.a)
